% Simulink data dictionary simulation_modelconfig.sldd

tSPhysics = 0.002
Physics_Speedgoat = Simulink.ConfigSet(StartTime="0", StopTime="inf", FixedStep="tSPhysics", Solver="ode2", ProdHWDeviceType="Generic->32-bit x86 compatible", SystemTargetFile="slrt.tlc", TargetLang="C")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
Physics_ERT = Simulink.ConfigSet(StartTime="0", StopTime="10", FixedStep="tSPhysics", Solver="ode2", ProdHWDeviceType="Intel->x86-64 (Windows64)", SystemTargetFile="ert.tlc", TargetLang="C++")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
Physics = Simulink.ConfigSet(StartTime="0", StopTime="35", FixedStep="tSPhysics", Solver="ode2", ProdHWDeviceType="Intel->x86-64 (Windows64)", SystemTargetFile="ert.tlc", TargetLang="C++")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