% Simulink data dictionary vehicleparameters_vehdynsim.sldd
% references simulation_modelconfig.sldd
% references simulation_interfaces.sldd

VEH__VehicleData__l_WheelbaseF_m = 1.6
VEH__VehicleData__l_WheelbaseTotal_m = 3.4
VEH__VehicleData__w_GeomCenterlineToCOG_m = 0
VEH__VehicleData__h_AxlePlaneToCOG_m = 0.02
VEH__VehicleData__w_TrackF_m = 1.7
VEH__VehicleData__w_TrackR_m = 1.7
VEH__Aerodynamics__cl_LongitudinalLift = -3
VEH__Aerodynamics__cpm_LongDragPitchMomentCoeff = 0
VEH__Aerodynamics__beta_wind_start_rad = 0
VEH__Aerodynamics__beta_wind_end_rad = 0.1
VEH__Aerodynamics__beta_wind_step_rad = 0.01
VEH__Aerodynamics__Cs_LatDragCoeff_start = 0
VEH__Aerodynamics__Cs_LatDragCoeff_end = 0.01
VEH__Aerodynamics__Cs_LatDragCoeff_step = 0.001
VEH__Aerodynamics__Cym_DragYawMomentCoeff_start = 0
VEH__Aerodynamics__Cym_DragYawMomentCoeff_end = 0.01
VEH__Aerodynamics__Cym_DragYawMomentCoeff_step = 0.001
VEH__Environment__p_Air_Pa = 101325
VEH__Environment__T_Air_K = 293.15
VEH__Environment__a_Gravity_mps2 = 9.81
VEH__Brakes__BrakeBias_Front = 0.6
VEH__Steering__T_Steering_s = 0.04
VEH__ActuatorLimitation__Fx_Throttle_max_N = 20000
VEH__ActuatorLimitation__Fx_Brake_max_N = -20000
VEH__ActuatorLimitation__deltaSteering_max_rad = 0.43
VEH__ActuatorLimitation__deltaSteering_min_rad = -0.43
VEH__Simulation__Sim_LongVelTolerance_mps = 0.01
VEH__Simulation__Sim_LongOff_m = 0
VEH__Simulation__Sim_LatOff_m = 0
VEH__Simulation__Sim_VertOff_m = 0
VEH__STMspecific__cLiftF = -1.8
VEH__STMspecific__cLiftR = -2.1
VEH__STMspecific__CoGz_m = 0.4
VEH__STMspecific__cRollFriction_Npmps = 200
VEH__STMspecific__MaxRollFriction_N = 200
VEH__STMspecific__T_YawRate_s = 0.15
VEH__STMspecific__T_LatVel_s = 0.15
VEH__STMspecific__T_Tire_s = 0.02
VEH__STMspecific__switchModelBlend_mps = 0.5
VEH__STMspecific__PTLimitLowVel_N = -500
VEH__STMspecific__switchModelVel_mps = 3
POWTR__MODE__activate_CombustionEngine = 0
POWTR__MODE__activate_ManualGearbox = 0
POWTR__MODE__activate_ThrottleInterface = 0
POWTR__LAYOUT__p_torque_rear = 0.5
POWTR__ENGINE__n_idle_rpm = 2000
POWTR__ENGINE__n_0_rpm = 2000
POWTR__ENGINE__n_ub_rpm = 6990
POWTR__ENGINE__n_limit_rpm = 7000
POWTR__ENGINE__I_engine_kgm2 = 0.2
POWTR__CLUTCH__T_max_cap_Nm = 750
POWTR__CLUTCH__clutch_time_s = 0.05
POWTR__TRANSMISSION__initial_gear = 0
POWTR__TRANSMISSION__I_transmission_kgm2 = 0.2
POWTR__DIFFERENTIAL__I_drivetrain_kgm2 = 2
POWTR__DIFFERENTIAL__c_diff_ratio = 3
POWTR__DIFFERENTIAL__c_diff_efficiency = 0.98
POWTR__DIFFERENTIAL__f_diff_ratio = 1
POWTR__DIFFERENTIAL__f_diff_efficiency = 0.99
POWTR__DIFFERENTIAL__r_diff_ratio = 1
POWTR__DIFFERENTIAL__r_diff_efficiency = 0.99
INIT__initialvalues__Vehicle_InitialRollAngle = 0
INIT__initialvalues__Vehicle_InitialPitchAngle = 0
INIT__initialvalues__Vehicle_InitialYawAngle = 0
INIT__initialvalues__Vehicle_InitialRollRate_radps = 0
INIT__initialvalues__Vehicle_InitialPitchRate_radps = 0
INIT__initialvalues__Vehicle_InitialYawRate_radps = 0
SUS__Compliance__Hmax_MaxHeightToHardblock_m = 0.5
SUS__Compliance__h_InertialFrameOffset_COGtoAxle_m = 0.134
SUS__Kinematics__k_ToeVSSteerF = 0
SUS__Kinematics__k_CasterVSSteerFrRe = 0
SUS__Kinematics__k_CamberVSSteerF = 0
SUS__Kinematics__k_HeightVSSteerF_mprad = 0.1432
tireFL__MFSIMPLE__PacLong_B = 4.7
tireFL__MFSIMPLE__PacLong_C = 2
tireFL__MFSIMPLE__PacLong_D = 2
tireFL__MFSIMPLE__PacLong_E = 1
tireFL__MFSIMPLE__PacLong_Fznom = 3000
tireFL__MFSIMPLE__PacLong_eps_load = 0
tireFL__MFSIMPLE__PacLat_B = 5
tireFL__MFSIMPLE__PacLat_C = 2.35
tireFL__MFSIMPLE__PacLat_D = 1.5
tireFL__MFSIMPLE__PacLat_E = 1
tireFL__MFSIMPLE__PacLat_Fznom = 3000
tireFL__MFSIMPLE__PacLat_eps_load = 0
tireFL__MFSIMPLE__r_tire_m = 0.42
tireFL__MFSIMPLE__Iyy_Wheel_kgm2 = 2
tireFL__ANGLE = 1
tireFL__TYRESIDE = 1
tireFL__USE_MODE = 14
tireFL__LONGVL = 11
tireFL__INERTIAL__m_Wheel_kg = 40
tireFL__INERTIAL__Iyy_Wheel_kgm2 = 2
tireFL__WHEEL__br_Nmsprad = 0
tireFL__WHEEL__FNOMIN = 2500
tireFL__WHEEL__NORMPRES = 210000
tireFL__WHEEL__TYRE_RADIUS_MOD = 0.42
tireFL__WHEEL__T_RelaxationLong = 2
tireFL__WHEEL__T_RelaxationLat = 3
tireFL__WHEEL__T_RelaxationMy = 100
tireFL__DIMENSION__UNLOADED_RADIUS = 0.42
tireFL__DIMENSION__WIDTH = 0.22
tireFL__DIMENSION__ASPECT_RATIO = 0.3
tireFL__DIMENSION__RIM_RADIUS = 0.229
tireFL__DIMENSION__RIM_WIDTH = 0.2667
tireFL__VERTICAL__VERTICAL_STIFFNESS = 240000
tireFL__VERTICAL__VERTICAL_DAMPING = 100
tireFL__VERTICAL__BREFF = 3.0e-8
tireFL__VERTICAL__DREFF = 0
tireFL__VERTICAL__FREFF = 0
tireFL__VERTICAL__Q_RE0 = 1
tireFL__VERTICAL__Q_V1 = 0
tireFL__VERTICAL__Q_V2 = 0
tireFL__VERTICAL__Q_FZ1 = 25
tireFL__VERTICAL__Q_FZ2 = 0
tireFL__VERTICAL__Q_FZ3 = 0
tireFL__VERTICAL__Q_FCX = 0
tireFL__VERTICAL__Q_FCY = 0
tireFL__VERTICAL__Q_FCY2 = 0
tireFL__VERTICAL__PFZ1 = 0
tireFL__SIMULATION__KPUMIN = -1.5
tireFL__SIMULATION__KPUMAX = 1.5
tireFL__SIMULATION__ALPMIN = -1.6
tireFL__SIMULATION__ALPMAX = 1.6
tireFL__SIMULATION__CAMMIN = -0.32
tireFL__SIMULATION__CAMMAX = 0.32
tireFL__SIMULATION__FZMIN = 1
tireFL__SIMULATION__FZMAX = 20000
tireFL__SIMULATION__LONGVL = 11
tireFL__SIMULATION__VXLOW = 1
tireFL__SIMULATION__PRESMIN = 10000
tireFL__SIMULATION__PRESMAX = 1000000
tireFL__SCALING__LFZO = 1
tireFL__SCALING__LCX = 1
tireFL__SCALING__LMUX = 0.97
tireFL__SCALING__LEX = 1
tireFL__SCALING__LKX = 1
tireFL__SCALING__LHX = 1
tireFL__SCALING__LVX = 1
tireFL__SCALING__LGAX = 1
tireFL__SCALING__LCY = 1
tireFL__SCALING__LMUY = 0.97
tireFL__SCALING__LEY = 1
tireFL__SCALING__LKY = 1
tireFL__SCALING__LHY = 1
tireFL__SCALING__LVY = 1
tireFL__SCALING__LGAY = 1
tireFL__SCALING__LTR = 1
tireFL__SCALING__LRES = 1
tireFL__SCALING__LGAZ = 1
tireFL__SCALING__LXAL = 1
tireFL__SCALING__LYKA = 1
tireFL__SCALING__LVYKA = 1
tireFL__SCALING__LS = 1
tireFL__SCALING__LSGKP = 1
tireFL__SCALING__LSGAL = 1
tireFL__SCALING__LGYR = 1
tireFL__SCALING__LMX = 1
tireFL__SCALING__LVMX = 1
tireFL__SCALING__LMY = 1
tireFL__SCALING__LMUV = 0
tireFL__SCALING__LCZ = 1
tireFL__SCALING__LMPHI = 1
tireFL__LONGITUDINAL__PCX1 = 1.6
tireFL__LONGITUDINAL__PDX1 = 1.5
tireFL__LONGITUDINAL__PDX2 = -0.04
tireFL__LONGITUDINAL__PDX3 = 0.1
tireFL__LONGITUDINAL__PEX1 = 0.7
tireFL__LONGITUDINAL__PEX2 = -0.17
tireFL__LONGITUDINAL__PEX3 = 0.023
tireFL__LONGITUDINAL__PEX4 = -0.14
tireFL__LONGITUDINAL__PKX1 = 30.7
tireFL__LONGITUDINAL__PKX2 = 0.27
tireFL__LONGITUDINAL__PKX3 = 0.13
tireFL__LONGITUDINAL__PHX1 = 0
tireFL__LONGITUDINAL__PHX2 = 0
tireFL__LONGITUDINAL__PVX1 = 0
tireFL__LONGITUDINAL__PVX2 = 0
tireFL__LONGITUDINAL__RBX1 = 17.4
tireFL__LONGITUDINAL__RBX2 = 12.9
tireFL__LONGITUDINAL__RCX1 = 1.1
tireFL__LONGITUDINAL__REX1 = 0
tireFL__LONGITUDINAL__REX2 = 0
tireFL__LONGITUDINAL__RHX1 = 0.001
tireFL__LONGITUDINAL__PTX1 = 0.75
tireFL__LONGITUDINAL__PTX2 = 0.007
tireFL__LONGITUDINAL__PTX3 = -0.13
tireFL__LONGITUDINAL__PPX1 = 0
tireFL__LONGITUDINAL__PPX2 = 0
tireFL__LONGITUDINAL__PPX3 = 0
tireFL__LONGITUDINAL__PPX4 = 0
tireFL__LONGITUDINAL__RBX3 = 0
tireFL__OVERTURNING__QSX1 = -0.001
tireFL__OVERTURNING__QSX2 = 2.1
tireFL__OVERTURNING__QSX3 = -0.04
tireFL__OVERTURNING__QSX4 = 0
tireFL__OVERTURNING__QSX5 = 0
tireFL__OVERTURNING__QSX6 = 0
tireFL__OVERTURNING__QSX7 = 0
tireFL__OVERTURNING__QSX8 = 0

tireFL__OVERTURNING__QSX9 = 0
tireFL__OVERTURNING__QSX10 = 0
tireFL__OVERTURNING__QSX11 = 0
tireFL__OVERTURNING__QSX12 = 0
tireFL__OVERTURNING__QSX13 = 0
tireFL__OVERTURNING__QSX14 = 0
tireFL__OVERTURNING__PPMX1 = 0
tireFL__LATERAL__PCY1 = 1.5
tireFL__LATERAL__PDY1 = 1.2
tireFL__LATERAL__PDY2 = -0.09
tireFL__LATERAL__PDY3 = 0.1
tireFL__LATERAL__PEY1 = 0.1
tireFL__LATERAL__PEY2 = -1.2
tireFL__LATERAL__PEY3 = 0.05
tireFL__LATERAL__PEY4 = -8.1
tireFL__LATERAL__PKY1 = -75.5
tireFL__LATERAL__PKY2 = 4.65
tireFL__LATERAL__PKY3 = -0.6
tireFL__LATERAL__PHY1 = 0.003
tireFL__LATERAL__PHY2 = -0.0006
tireFL__LATERAL__PHY3 = 0.004
tireFL__LATERAL__PVY1 = 0.04
tireFL__LATERAL__PVY2 = -0.02
tireFL__LATERAL__PVY3 = -0.97
tireFL__LATERAL__PVY4 = -0.41
tireFL__LATERAL__RBY1 = 20.6
tireFL__LATERAL__RBY2 = -23.5
tireFL__LATERAL__RBY3 = 0.001
tireFL__LATERAL__RCY1 = 1
tireFL__LATERAL__REY1 = 0
tireFL__LATERAL__REY2 = 0
tireFL__LATERAL__RHY1 = -0.02
tireFL__LATERAL__RHY2 = 0
tireFL__LATERAL__RVY1 = 0.16
tireFL__LATERAL__RVY2 = 0.03
tireFL__LATERAL__RVY3 = 27.5
tireFL__LATERAL__RVY4 = -29.7
tireFL__LATERAL__RVY5 = 0.03
tireFL__LATERAL__RVY6 = 0
tireFL__LATERAL__PTY1 = 3.8
tireFL__LATERAL__PTY2 = 4.7
tireFL__LATERAL__PEY5 = 0
tireFL__LATERAL__PKY4 = 2
tireFL__LATERAL__PKY5 = 0
tireFL__LATERAL__PKY6 = 0
tireFL__LATERAL__PKY7 = 0
tireFL__LATERAL__PPY1 = 0
tireFL__LATERAL__PPY2 = 0
tireFL__LATERAL__PPY3 = 0
tireFL__LATERAL__PPY4 = 0
tireFL__LATERAL__PPY5 = 0
tireFL__LATERAL__RBY4 = 0
tireFL__ROLLING__QSY1 = 0.01
tireFL__ROLLING__QSY2 = 0
tireFL__ROLLING__QSY3 = 0
tireFL__ROLLING__QSY4 = 0
tireFL__ROLLING__QSY5 = 0
tireFL__ROLLING__QSY6 = 0
tireFL__ROLLING__QSY7 = 1
tireFL__ROLLING__QSY8 = 1
tireFL__ALIGNING__QBZ1 = 9
tireFL__ALIGNING__QBZ2 = 6.3
tireFL__ALIGNING__QBZ3 = -0.5
tireFL__ALIGNING__QBZ4 = -2.3
tireFL__ALIGNING__QBZ5 = 2.7
tireFL__ALIGNING__QBZ9 = -13.5
tireFL__ALIGNING__QBZ10 = 0
tireFL__ALIGNING__QCZ1 = 1.1
tireFL__ALIGNING__QDZ1 = 0.08
tireFL__ALIGNING__QDZ2 = 0.004
tireFL__ALIGNING__QDZ3 = -1.9
tireFL__ALIGNING__QDZ4 = -2
tireFL__ALIGNING__QDZ6 = -0.005
tireFL__ALIGNING__QDZ7 = 0.01
tireFL__ALIGNING__QDZ8 = -0.65
tireFL__ALIGNING__QDZ9 = -0.06
tireFL__ALIGNING__QEZ1 = -9
tireFL__ALIGNING__QEZ2 = 11
tireFL__ALIGNING__QEZ3 = -5.9
tireFL__ALIGNING__QEZ4 = 0.24
tireFL__ALIGNING__QEZ5 = -15.9
tireFL__ALIGNING__QHZ1 = 0.007
tireFL__ALIGNING__QHZ2 = -0.001
tireFL__ALIGNING__QHZ3 = -0.18
tireFL__ALIGNING__QHZ4 = 0.23
tireFL__ALIGNING__SSZ1 = -0.01
tireFL__ALIGNING__SSZ2 = 0.05
tireFL__ALIGNING__SSZ3 = 2.4
tireFL__ALIGNING__SSZ4 = -1
tireFL__ALIGNING__QTZ1 = 0
tireFL__ALIGNING__MBELT = 0
tireFL__ALIGNING__QBZ6 = 0
tireFL__ALIGNING__QDZ10 = 0
tireFL__ALIGNING__QDZ11 = 0
tireFL__ALIGNING__PPZ1 = 0
tireFL__ALIGNING__PPZ2 = 0
tireFL__TURNSLIP__PDXP1 = 0.4
tireFL__TURNSLIP__PDXP2 = 0
tireFL__TURNSLIP__PDXP3 = 0
tireFL__TURNSLIP__PKYP1 = 1
tireFL__TURNSLIP__PDYP1 = 0.4
tireFL__TURNSLIP__PDYP2 = 0
tireFL__TURNSLIP__PDYP3 = 0
tireFL__TURNSLIP__PDYP4 = 0
tireFL__TURNSLIP__PHYP1 = 1
tireFL__TURNSLIP__PHYP2 = 0.15
tireFL__TURNSLIP__PHYP3 = 0
tireFL__TURNSLIP__PHYP4 = -4
tireFL__TURNSLIP__PECP1 = 0.5
tireFL__TURNSLIP__PECP2 = 0
tireFL__TURNSLIP__QDTP1 = 10
tireFL__TURNSLIP__QCRP1 = 0.2
tireFL__TURNSLIP__QCRP2 = 0.1
tireFL__TURNSLIP__QBRP1 = 0.1
tireFL__TURNSLIP__QDRP1 = 1
tireFL__TURNSLIP__QDRP2 = 0
tireFL__CONTACTPATCH__Q_RA1 = 0
tireFL__CONTACTPATCH__Q_RA2 = 0
tireFL__CONTACTPATCH__Q_RB1 = 0
tireFL__CONTACTPATCH__Q_RB2 = 0
tireFL__CONTACTPATCH__k1_TireFB_PT1 = 0.002
tireFL__CONTACTPATCH__k1_WheelsFB_PT1 = 0.002
tireFL__CONTACTPATCH__k2_TireFB_PT1 = 0.002
tireFL__CONTACTPATCH__p_Tires_Pa = 220000
tireFL__STRUCTURAL__LONGITUDINAL_STIFFNESS = 450000
tireFL__STRUCTURAL__LATERAL_STIFFNESS = 120000
tireFL__STRUCTURAL__PCFX1 = 0
tireFL__STRUCTURAL__PCFX2 = 0
tireFL__STRUCTURAL__PCFX3 = 0
tireFL__STRUCTURAL__PCFY1 = 0
tireFL__STRUCTURAL__PCFY2 = 0
tireFL__STRUCTURAL__PCFY3 = 0
tireFR__MFSIMPLE__PacLong_B = 4.7
tireFR__MFSIMPLE__PacLong_C = 2
tireFR__MFSIMPLE__PacLong_D = 2
tireFR__MFSIMPLE__PacLong_E = 1
tireFR__MFSIMPLE__PacLong_Fznom = 3000
tireFR__MFSIMPLE__PacLong_eps_load = 0
tireFR__MFSIMPLE__PacLat_B = 5
tireFR__MFSIMPLE__PacLat_C = 2.35
tireFR__MFSIMPLE__PacLat_D = 1.5
tireFR__MFSIMPLE__PacLat_E = 1
tireFR__MFSIMPLE__PacLat_Fznom = 3000
tireFR__MFSIMPLE__PacLat_eps_load = 0
tireFR__MFSIMPLE__r_tire_m = 0.42
tireFR__MFSIMPLE__Iyy_Wheel_kgm2 = 2
tireFR__ANGLE = 1
tireFR__TYRESIDE = -1
tireFR__USE_MODE = 14
tireFR__LONGVL = 11
tireFR__INERTIAL__m_Wheel_kg = 40
tireFR__INERTIAL__Iyy_Wheel_kgm2 = 2
tireFR__WHEEL__br_Nmsprad = 0
tireFR__WHEEL__FNOMIN = 2500
tireFR__WHEEL__NORMPRES = 210000
tireFR__WHEEL__TYRE_RADIUS_MOD = 0.42
tireFR__WHEEL__T_RelaxationLong = 2
tireFR__WHEEL__T_RelaxationLat = 3
tireFR__WHEEL__T_RelaxationMy = 100
tireFR__DIMENSION__UNLOADED_RADIUS = 0.42
tireFR__DIMENSION__WIDTH = 0.22
tireFR__DIMENSION__ASPECT_RATIO = 0.3
tireFR__DIMENSION__RIM_RADIUS = 0.229
tireFR__DIMENSION__RIM_WIDTH = 0.2667
tireFR__VERTICAL__VERTICAL_STIFFNESS = 240000
tireFR__VERTICAL__VERTICAL_DAMPING = 100
tireFR__VERTICAL__BREFF = 3.0e-8
tireFR__VERTICAL__DREFF = 0
tireFR__VERTICAL__FREFF = 0
tireFR__VERTICAL__Q_RE0 = 1
tireFR__VERTICAL__Q_V1 = 0
tireFR__VERTICAL__Q_V2 = 0
tireFR__VERTICAL__Q_FZ1 = 25
tireFR__VERTICAL__Q_FZ2 = 0
tireFR__VERTICAL__Q_FZ3 = 0
tireFR__VERTICAL__Q_FCX = 0
tireFR__VERTICAL__Q_FCY = 0
tireFR__VERTICAL__Q_FCY2 = 0
tireFR__VERTICAL__PFZ1 = 0
tireFR__SIMULATION__KPUMIN = -1.5
tireFR__SIMULATION__KPUMAX = 1.5
tireFR__SIMULATION__ALPMIN = -1.6
tireFR__SIMULATION__ALPMAX = 1.6
tireFR__SIMULATION__CAMMIN = -0.32
tireFR__SIMULATION__CAMMAX = 0.32
tireFR__SIMULATION__FZMIN = 1
tireFR__SIMULATION__FZMAX = 20000
tireFR__SIMULATION__LONGVL = 11
tireFR__SIMULATION__VXLOW = 1
tireFR__SIMULATION__PRESMIN = 10000
tireFR__SIMULATION__PRESMAX = 1000000
tireFR__SCALING__LFZO = 1
tireFR__SCALING__LCX = 1
tireFR__SCALING__LMUX = 0.97
tireFR__SCALING__LEX = 1
tireFR__SCALING__LKX = 1
tireFR__SCALING__LHX = 1
tireFR__SCALING__LVX = 1
tireFR__SCALING__LGAX = 1
tireFR__SCALING__LCY = 1

tireFR__SCALING__LMUY = 0.97
tireFR__SCALING__LEY = 1
tireFR__SCALING__LKY = 1
tireFR__SCALING__LHY = 1
tireFR__SCALING__LVY = 1
tireFR__SCALING__LGAY = 1
tireFR__SCALING__LTR = 1
tireFR__SCALING__LRES = 1
tireFR__SCALING__LGAZ = 1
tireFR__SCALING__LXAL = 1
tireFR__SCALING__LYKA = 1
tireFR__SCALING__LVYKA = 1
tireFR__SCALING__LS = 1
tireFR__SCALING__LSGKP = 1
tireFR__SCALING__LSGAL = 1
tireFR__SCALING__LGYR = 1
tireFR__SCALING__LMX = 1
tireFR__SCALING__LVMX = 1
tireFR__SCALING__LMY = 1
tireFR__SCALING__LMUV = 0
tireFR__SCALING__LCZ = 1
tireFR__SCALING__LMPHI = 1
tireFR__LONGITUDINAL__PCX1 = 1.6
tireFR__LONGITUDINAL__PDX1 = 1.5
tireFR__LONGITUDINAL__PDX2 = -0.04
tireFR__LONGITUDINAL__PDX3 = 0.1
tireFR__LONGITUDINAL__PEX1 = 0.7
tireFR__LONGITUDINAL__PEX2 = -0.17
tireFR__LONGITUDINAL__PEX3 = 0.023
tireFR__LONGITUDINAL__PEX4 = -0.14
tireFR__LONGITUDINAL__PKX1 = 30.7
tireFR__LONGITUDINAL__PKX2 = 0.27
tireFR__LONGITUDINAL__PKX3 = 0.13
tireFR__LONGITUDINAL__PHX1 = 0
tireFR__LONGITUDINAL__PHX2 = 0
tireFR__LONGITUDINAL__PVX1 = 0
tireFR__LONGITUDINAL__PVX2 = 0
tireFR__LONGITUDINAL__RBX1 = 17.4
tireFR__LONGITUDINAL__RBX2 = 12.9
tireFR__LONGITUDINAL__RCX1 = 1.1
tireFR__LONGITUDINAL__REX1 = 0
tireFR__LONGITUDINAL__REX2 = 0
tireFR__LONGITUDINAL__RHX1 = 0.001
tireFR__LONGITUDINAL__PTX1 = 0.75
tireFR__LONGITUDINAL__PTX2 = 0.007
tireFR__LONGITUDINAL__PTX3 = -0.13
tireFR__LONGITUDINAL__PPX1 = 0
tireFR__LONGITUDINAL__PPX2 = 0
tireFR__LONGITUDINAL__PPX3 = 0
tireFR__LONGITUDINAL__PPX4 = 0
tireFR__LONGITUDINAL__RBX3 = 0
tireFR__OVERTURNING__QSX1 = -0.001
tireFR__OVERTURNING__QSX2 = 2.1
tireFR__OVERTURNING__QSX3 = -0.04
tireFR__OVERTURNING__QSX4 = 0
tireFR__OVERTURNING__QSX5 = 0
tireFR__OVERTURNING__QSX6 = 0
tireFR__OVERTURNING__QSX7 = 0
tireFR__OVERTURNING__QSX8 = 0
tireFR__OVERTURNING__QSX9 = 0
tireFR__OVERTURNING__QSX10 = 0
tireFR__OVERTURNING__QSX11 = 0
tireFR__OVERTURNING__QSX12 = 0
tireFR__OVERTURNING__QSX13 = 0
tireFR__OVERTURNING__QSX14 = 0
tireFR__OVERTURNING__PPMX1 = 0
tireFR__LATERAL__PCY1 = 1.5
tireFR__LATERAL__PDY1 = 1.2
tireFR__LATERAL__PDY2 = -0.09
tireFR__LATERAL__PDY3 = 0.1
tireFR__LATERAL__PEY1 = 0.1
tireFR__LATERAL__PEY2 = -1.2
tireFR__LATERAL__PEY3 = 0.05
tireFR__LATERAL__PEY4 = -8.1
tireFR__LATERAL__PKY1 = -75.5
tireFR__LATERAL__PKY2 = 4.65
tireFR__LATERAL__PKY3 = -0.6
tireFR__LATERAL__PHY1 = 0.003
tireFR__LATERAL__PHY2 = -0.0006
tireFR__LATERAL__PHY3 = 0.004
tireFR__LATERAL__PVY1 = 0.04
tireFR__LATERAL__PVY2 = -0.02
tireFR__LATERAL__PVY3 = -0.97
tireFR__LATERAL__PVY4 = -0.41
tireFR__LATERAL__RBY1 = 20.6
tireFR__LATERAL__RBY2 = -23.5
tireFR__LATERAL__RBY3 = 0.001
tireFR__LATERAL__RCY1 = 1
tireFR__LATERAL__REY1 = 0
tireFR__LATERAL__REY2 = 0
tireFR__LATERAL__RHY1 = -0.02
tireFR__LATERAL__RHY2 = 0
tireFR__LATERAL__RVY1 = 0.16
tireFR__LATERAL__RVY2 = 0.03
tireFR__LATERAL__RVY3 = 27.5
tireFR__LATERAL__RVY4 = -29.7
tireFR__LATERAL__RVY5 = 0.03
tireFR__LATERAL__RVY6 = 0
tireFR__LATERAL__PTY1 = 3.8
tireFR__LATERAL__PTY2 = 4.7
tireFR__LATERAL__PEY5 = 0
tireFR__LATERAL__PKY4 = 2
tireFR__LATERAL__PKY5 = 0
tireFR__LATERAL__PKY6 = 0
tireFR__LATERAL__PKY7 = 0
tireFR__LATERAL__PPY1 = 0
tireFR__LATERAL__PPY2 = 0
tireFR__LATERAL__PPY3 = 0
tireFR__LATERAL__PPY4 = 0
tireFR__LATERAL__PPY5 = 0
tireFR__LATERAL__RBY4 = 0
tireFR__ROLLING__QSY1 = 0.01
tireFR__ROLLING__QSY2 = 0
tireFR__ROLLING__QSY3 = 0
tireFR__ROLLING__QSY4 = 0
tireFR__ROLLING__QSY5 = 0
tireFR__ROLLING__QSY6 = 0
tireFR__ROLLING__QSY7 = 1
tireFR__ROLLING__QSY8 = 1
tireFR__ALIGNING__QBZ1 = 9
tireFR__ALIGNING__QBZ2 = 6.3
tireFR__ALIGNING__QBZ3 = -0.5
tireFR__ALIGNING__QBZ4 = -2.3
tireFR__ALIGNING__QBZ5 = 2.7
tireFR__ALIGNING__QBZ9 = -13.5
tireFR__ALIGNING__QBZ10 = 0
tireFR__ALIGNING__QCZ1 = 1.1
tireFR__ALIGNING__QDZ1 = 0.08
tireFR__ALIGNING__QDZ2 = 0.004
tireFR__ALIGNING__QDZ3 = -1.9
tireFR__ALIGNING__QDZ4 = -2
tireFR__ALIGNING__QDZ6 = -0.005
tireFR__ALIGNING__QDZ7 = 0.01
tireFR__ALIGNING__QDZ8 = -0.65
tireFR__ALIGNING__QDZ9 = -0.06
tireFR__ALIGNING__QEZ1 = -9
tireFR__ALIGNING__QEZ2 = 11
tireFR__ALIGNING__QEZ3 = -5.9
tireFR__ALIGNING__QEZ4 = 0.24
tireFR__ALIGNING__QEZ5 = -15.9
tireFR__ALIGNING__QHZ1 = 0.007
tireFR__ALIGNING__QHZ2 = -0.001
tireFR__ALIGNING__QHZ3 = -0.18
tireFR__ALIGNING__QHZ4 = 0.23
tireFR__ALIGNING__SSZ1 = -0.01
tireFR__ALIGNING__SSZ2 = 0.05
tireFR__ALIGNING__SSZ3 = 2.4
tireFR__ALIGNING__SSZ4 = -1
tireFR__ALIGNING__QTZ1 = 0
tireFR__ALIGNING__MBELT = 0
tireFR__ALIGNING__QBZ6 = 0
tireFR__ALIGNING__QDZ10 = 0
tireFR__ALIGNING__QDZ11 = 0
tireFR__ALIGNING__PPZ1 = 0
tireFR__ALIGNING__PPZ2 = 0
tireFR__TURNSLIP__PDXP1 = 0.4
tireFR__TURNSLIP__PDXP2 = 0
tireFR__TURNSLIP__PDXP3 = 0
tireFR__TURNSLIP__PKYP1 = 1
tireFR__TURNSLIP__PDYP1 = 0.4
tireFR__TURNSLIP__PDYP2 = 0
tireFR__TURNSLIP__PDYP3 = 0
tireFR__TURNSLIP__PDYP4 = 0
tireFR__TURNSLIP__PHYP1 = 1
tireFR__TURNSLIP__PHYP2 = 0.15
tireFR__TURNSLIP__PHYP3 = 0
tireFR__TURNSLIP__PHYP4 = -4
tireFR__TURNSLIP__PECP1 = 0.5
tireFR__TURNSLIP__PECP2 = 0
tireFR__TURNSLIP__QDTP1 = 10
tireFR__TURNSLIP__QCRP1 = 0.2
tireFR__TURNSLIP__QCRP2 = 0.1
tireFR__TURNSLIP__QBRP1 = 0.1
tireFR__TURNSLIP__QDRP1 = 1
tireFR__TURNSLIP__QDRP2 = 0
tireFR__CONTACTPATCH__Q_RA1 = 0
tireFR__CONTACTPATCH__Q_RA2 = 0
tireFR__CONTACTPATCH__Q_RB1 = 0
tireFR__CONTACTPATCH__Q_RB2 = 0
tireFR__CONTACTPATCH__k1_TireFB_PT1 = 0.002
tireFR__CONTACTPATCH__k1_WheelsFB_PT1 = 0.002
tireFR__CONTACTPATCH__k2_TireFB_PT1 = 0.002
tireFR__CONTACTPATCH__p_Tires_Pa = 220000
tireFR__STRUCTURAL__LONGITUDINAL_STIFFNESS = 450000
tireFR__STRUCTURAL__LATERAL_STIFFNESS = 120000
tireFR__STRUCTURAL__PCFX1 = 0
tireFR__STRUCTURAL__PCFX2 = 0
tireFR__STRUCTURAL__PCFX3 = 0
tireFR__STRUCTURAL__PCFY1 = 0
tireFR__STRUCTURAL__PCFY2 = 0
tireFR__STRUCTURAL__PCFY3 = 0
tireRL__MFSIMPLE__PacLong_B = 4.7
tireRL__MFSIMPLE__PacLong_C = 2
tireRL__MFSIMPLE__PacLong_D = 2
tireRL__MFSIMPLE__PacLong_E = 1
tireRL__MFSIMPLE__PacLong_Fznom = 3000
tireRL__MFSIMPLE__PacLong_eps_load = 0
tireRL__MFSIMPLE__PacLat_B = 5
tireRL__MFSIMPLE__PacLat_C = 2.35
tireRL__MFSIMPLE__PacLat_D = 1.5

tireRL__MFSIMPLE__PacLat_E = 1
tireRL__MFSIMPLE__PacLat_Fznom = 3000
tireRL__MFSIMPLE__PacLat_eps_load = 0
tireRL__MFSIMPLE__r_tire_m = 0.42
tireRL__MFSIMPLE__Iyy_Wheel_kgm2 = 2
tireRL__ANGLE = 1
tireRL__TYRESIDE = 1
tireRL__USE_MODE = 14
tireRL__LONGVL = 11
tireRL__INERTIAL__m_Wheel_kg = 40
tireRL__INERTIAL__Iyy_Wheel_kgm2 = 2
tireRL__WHEEL__br_Nmsprad = 0
tireRL__WHEEL__FNOMIN = 2500
tireRL__WHEEL__NORMPRES = 210000
tireRL__WHEEL__TYRE_RADIUS_MOD = 0.42
tireRL__WHEEL__T_RelaxationLong = 2
tireRL__WHEEL__T_RelaxationLat = 3
tireRL__WHEEL__T_RelaxationMy = 100
tireRL__DIMENSION__UNLOADED_RADIUS = 0.42
tireRL__DIMENSION__WIDTH = 0.22
tireRL__DIMENSION__ASPECT_RATIO = 0.3
tireRL__DIMENSION__RIM_RADIUS = 0.229
tireRL__DIMENSION__RIM_WIDTH = 0.2667
tireRL__VERTICAL__VERTICAL_STIFFNESS = 240000
tireRL__VERTICAL__VERTICAL_DAMPING = 100
tireRL__VERTICAL__BREFF = 3.0e-8
tireRL__VERTICAL__DREFF = 0
tireRL__VERTICAL__FREFF = 0
tireRL__VERTICAL__Q_RE0 = 1
tireRL__VERTICAL__Q_V1 = 0
tireRL__VERTICAL__Q_V2 = 0
tireRL__VERTICAL__Q_FZ1 = 25
tireRL__VERTICAL__Q_FZ2 = 0
tireRL__VERTICAL__Q_FZ3 = 0
tireRL__VERTICAL__Q_FCX = 0
tireRL__VERTICAL__Q_FCY = 0
tireRL__VERTICAL__Q_FCY2 = 0
tireRL__VERTICAL__PFZ1 = 0
tireRL__SIMULATION__KPUMIN = -1.5
tireRL__SIMULATION__KPUMAX = 1.5
tireRL__SIMULATION__ALPMIN = -1.6
tireRL__SIMULATION__ALPMAX = 1.6
tireRL__SIMULATION__CAMMIN = -0.32
tireRL__SIMULATION__CAMMAX = 0.32
tireRL__SIMULATION__FZMIN = 1
tireRL__SIMULATION__FZMAX = 20000
tireRL__SIMULATION__LONGVL = 11
tireRL__SIMULATION__VXLOW = 1
tireRL__SIMULATION__PRESMIN = 10000
tireRL__SIMULATION__PRESMAX = 1000000
tireRL__SCALING__LFZO = 1
tireRL__SCALING__LCX = 1
tireRL__SCALING__LMUX = 0.97
tireRL__SCALING__LEX = 1
tireRL__SCALING__LKX = 1
tireRL__SCALING__LHX = 1
tireRL__SCALING__LVX = 1
tireRL__SCALING__LGAX = 1
tireRL__SCALING__LCY = 1
tireRL__SCALING__LMUY = 0.97
tireRL__SCALING__LEY = 1
tireRL__SCALING__LKY = 1
tireRL__SCALING__LHY = 1
tireRL__SCALING__LVY = 1
tireRL__SCALING__LGAY = 1
tireRL__SCALING__LTR = 1
tireRL__SCALING__LRES = 1
tireRL__SCALING__LGAZ = 1
tireRL__SCALING__LXAL = 1
tireRL__SCALING__LYKA = 1
tireRL__SCALING__LVYKA = 1
tireRL__SCALING__LS = 1
tireRL__SCALING__LSGKP = 1
tireRL__SCALING__LSGAL = 1
tireRL__SCALING__LGYR = 1
tireRL__SCALING__LMX = 1
tireRL__SCALING__LVMX = 1
tireRL__SCALING__LMY = 1
tireRL__SCALING__LMUV = 0
tireRL__SCALING__LCZ = 1
tireRL__SCALING__LMPHI = 1
tireRL__LONGITUDINAL__PCX1 = 1.6
tireRL__LONGITUDINAL__PDX1 = 1.5
tireRL__LONGITUDINAL__PDX2 = -0.04
tireRL__LONGITUDINAL__PDX3 = 0.1
tireRL__LONGITUDINAL__PEX1 = 0.7
tireRL__LONGITUDINAL__PEX2 = -0.17
tireRL__LONGITUDINAL__PEX3 = 0.023
tireRL__LONGITUDINAL__PEX4 = -0.14
tireRL__LONGITUDINAL__PKX1 = 30.7
tireRL__LONGITUDINAL__PKX2 = 0.27
tireRL__LONGITUDINAL__PKX3 = 0.13
tireRL__LONGITUDINAL__PHX1 = 0
tireRL__LONGITUDINAL__PHX2 = 0
tireRL__LONGITUDINAL__PVX1 = 0
tireRL__LONGITUDINAL__PVX2 = 0
tireRL__LONGITUDINAL__RBX1 = 17.4
tireRL__LONGITUDINAL__RBX2 = 12.9
tireRL__LONGITUDINAL__RCX1 = 1.1
tireRL__LONGITUDINAL__REX1 = 0
tireRL__LONGITUDINAL__REX2 = 0
tireRL__LONGITUDINAL__RHX1 = 0.001
tireRL__LONGITUDINAL__PTX1 = 0.75
tireRL__LONGITUDINAL__PTX2 = 0.007
tireRL__LONGITUDINAL__PTX3 = -0.13
tireRL__LONGITUDINAL__PPX1 = 0
tireRL__LONGITUDINAL__PPX2 = 0
tireRL__LONGITUDINAL__PPX3 = 0
tireRL__LONGITUDINAL__PPX4 = 0
tireRL__LONGITUDINAL__RBX3 = 0
tireRL__OVERTURNING__QSX1 = -0.001
tireRL__OVERTURNING__QSX2 = 2.1
tireRL__OVERTURNING__QSX3 = -0.04
tireRL__OVERTURNING__QSX4 = 0
tireRL__OVERTURNING__QSX5 = 0
tireRL__OVERTURNING__QSX6 = 0
tireRL__OVERTURNING__QSX7 = 0
tireRL__OVERTURNING__QSX8 = 0
tireRL__OVERTURNING__QSX9 = 0
tireRL__OVERTURNING__QSX10 = 0
tireRL__OVERTURNING__QSX11 = 0
tireRL__OVERTURNING__QSX12 = 0
tireRL__OVERTURNING__QSX13 = 0
tireRL__OVERTURNING__QSX14 = 0
tireRL__OVERTURNING__PPMX1 = 0
tireRL__LATERAL__PCY1 = 1.5
tireRL__LATERAL__PDY1 = 1.2
tireRL__LATERAL__PDY2 = -0.09
tireRL__LATERAL__PDY3 = 0.1
tireRL__LATERAL__PEY1 = 0.1
tireRL__LATERAL__PEY2 = -1.2
tireRL__LATERAL__PEY3 = 0.05
tireRL__LATERAL__PEY4 = -8.1
tireRL__LATERAL__PKY1 = -75.5
tireRL__LATERAL__PKY2 = 4.65
tireRL__LATERAL__PKY3 = -0.6
tireRL__LATERAL__PHY1 = 0.003
tireRL__LATERAL__PHY2 = -0.0006
tireRL__LATERAL__PHY3 = 0.004
tireRL__LATERAL__PVY1 = 0.04
tireRL__LATERAL__PVY2 = -0.02
tireRL__LATERAL__PVY3 = -0.97
tireRL__LATERAL__PVY4 = -0.41
tireRL__LATERAL__RBY1 = 20.6
tireRL__LATERAL__RBY2 = -23.5
tireRL__LATERAL__RBY3 = 0.001
tireRL__LATERAL__RCY1 = 1
tireRL__LATERAL__REY1 = 0
tireRL__LATERAL__REY2 = 0
tireRL__LATERAL__RHY1 = -0.02
tireRL__LATERAL__RHY2 = 0
tireRL__LATERAL__RVY1 = 0.16
tireRL__LATERAL__RVY2 = 0.03
tireRL__LATERAL__RVY3 = 27.5
tireRL__LATERAL__RVY4 = -29.7
tireRL__LATERAL__RVY5 = 0.03
tireRL__LATERAL__RVY6 = 0
tireRL__LATERAL__PTY1 = 3.8
tireRL__LATERAL__PTY2 = 4.7
tireRL__LATERAL__PEY5 = 0
tireRL__LATERAL__PKY4 = 2
tireRL__LATERAL__PKY5 = 0
tireRL__LATERAL__PKY6 = 0
tireRL__LATERAL__PKY7 = 0
tireRL__LATERAL__PPY1 = 0
tireRL__LATERAL__PPY2 = 0
tireRL__LATERAL__PPY3 = 0
tireRL__LATERAL__PPY4 = 0
tireRL__LATERAL__PPY5 = 0
tireRL__LATERAL__RBY4 = 0
tireRL__ROLLING__QSY1 = 0.01
tireRL__ROLLING__QSY2 = 0
tireRL__ROLLING__QSY3 = 0
tireRL__ROLLING__QSY4 = 0
tireRL__ROLLING__QSY5 = 0
tireRL__ROLLING__QSY6 = 0
tireRL__ROLLING__QSY7 = 1
tireRL__ROLLING__QSY8 = 1
tireRL__ALIGNING__QBZ1 = 9
tireRL__ALIGNING__QBZ2 = 6.3
tireRL__ALIGNING__QBZ3 = -0.5
tireRL__ALIGNING__QBZ4 = -2.3
tireRL__ALIGNING__QBZ5 = 2.7
tireRL__ALIGNING__QBZ9 = -13.5
tireRL__ALIGNING__QBZ10 = 0
tireRL__ALIGNING__QCZ1 = 1.1
tireRL__ALIGNING__QDZ1 = 0.08
tireRL__ALIGNING__QDZ2 = 0.004
tireRL__ALIGNING__QDZ3 = -1.9
tireRL__ALIGNING__QDZ4 = -2
tireRL__ALIGNING__QDZ6 = -0.005
tireRL__ALIGNING__QDZ7 = 0.01
tireRL__ALIGNING__QDZ8 = -0.65
tireRL__ALIGNING__QDZ9 = -0.06
tireRL__ALIGNING__QEZ1 = -9
tireRL__ALIGNING__QEZ2 = 11
tireRL__ALIGNING__QEZ3 = -5.9
tireRL__ALIGNING__QEZ4 = 0.24
tireRL__ALIGNING__QEZ5 = -15.9
tireRL__ALIGNING__QHZ1 = 0.007

tireRL__ALIGNING__QHZ2 = -0.001
tireRL__ALIGNING__QHZ3 = -0.18
tireRL__ALIGNING__QHZ4 = 0.23
tireRL__ALIGNING__SSZ1 = -0.01
tireRL__ALIGNING__SSZ2 = 0.05
tireRL__ALIGNING__SSZ3 = 2.4
tireRL__ALIGNING__SSZ4 = -1
tireRL__ALIGNING__QTZ1 = 0
tireRL__ALIGNING__MBELT = 0
tireRL__ALIGNING__QBZ6 = 0
tireRL__ALIGNING__QDZ10 = 0
tireRL__ALIGNING__QDZ11 = 0
tireRL__ALIGNING__PPZ1 = 0
tireRL__ALIGNING__PPZ2 = 0
tireRL__TURNSLIP__PDXP1 = 0.4
tireRL__TURNSLIP__PDXP2 = 0
tireRL__TURNSLIP__PDXP3 = 0
tireRL__TURNSLIP__PKYP1 = 1
tireRL__TURNSLIP__PDYP1 = 0.4
tireRL__TURNSLIP__PDYP2 = 0
tireRL__TURNSLIP__PDYP3 = 0
tireRL__TURNSLIP__PDYP4 = 0
tireRL__TURNSLIP__PHYP1 = 1
tireRL__TURNSLIP__PHYP2 = 0.15
tireRL__TURNSLIP__PHYP3 = 0
tireRL__TURNSLIP__PHYP4 = -4
tireRL__TURNSLIP__PECP1 = 0.5
tireRL__TURNSLIP__PECP2 = 0
tireRL__TURNSLIP__QDTP1 = 10
tireRL__TURNSLIP__QCRP1 = 0.2
tireRL__TURNSLIP__QCRP2 = 0.1
tireRL__TURNSLIP__QBRP1 = 0.1
tireRL__TURNSLIP__QDRP1 = 1
tireRL__TURNSLIP__QDRP2 = 0
tireRL__CONTACTPATCH__Q_RA1 = 0
tireRL__CONTACTPATCH__Q_RA2 = 0
tireRL__CONTACTPATCH__Q_RB1 = 0
tireRL__CONTACTPATCH__Q_RB2 = 0
tireRL__CONTACTPATCH__k1_TireFB_PT1 = 0.002
tireRL__CONTACTPATCH__k1_WheelsFB_PT1 = 0.002
tireRL__CONTACTPATCH__k2_TireFB_PT1 = 0.002
tireRL__CONTACTPATCH__p_Tires_Pa = 220000
tireRL__STRUCTURAL__LONGITUDINAL_STIFFNESS = 450000
tireRL__STRUCTURAL__LATERAL_STIFFNESS = 120000
tireRL__STRUCTURAL__PCFX1 = 0
tireRL__STRUCTURAL__PCFX2 = 0
tireRL__STRUCTURAL__PCFX3 = 0
tireRL__STRUCTURAL__PCFY1 = 0
tireRL__STRUCTURAL__PCFY2 = 0
tireRL__STRUCTURAL__PCFY3 = 0
tireRR__MFSIMPLE__PacLong_B = 4.7
tireRR__MFSIMPLE__PacLong_C = 2
tireRR__MFSIMPLE__PacLong_D = 2
tireRR__MFSIMPLE__PacLong_E = 1
tireRR__MFSIMPLE__PacLong_Fznom = 3000
tireRR__MFSIMPLE__PacLong_eps_load = 0
tireRR__MFSIMPLE__PacLat_B = 5
tireRR__MFSIMPLE__PacLat_C = 2.35
tireRR__MFSIMPLE__PacLat_D = 1.5
tireRR__MFSIMPLE__PacLat_E = 1
tireRR__MFSIMPLE__PacLat_Fznom = 3000
tireRR__MFSIMPLE__PacLat_eps_load = 0
tireRR__MFSIMPLE__r_tire_m = 0.42
tireRR__MFSIMPLE__Iyy_Wheel_kgm2 = 2
tireRR__ANGLE = 1
tireRR__TYRESIDE = -1
tireRR__USE_MODE = 14
tireRR__LONGVL = 11
tireRR__INERTIAL__m_Wheel_kg = 40
tireRR__INERTIAL__Iyy_Wheel_kgm2 = 2
tireRR__WHEEL__br_Nmsprad = 0
tireRR__WHEEL__FNOMIN = 2500
tireRR__WHEEL__NORMPRES = 210000
tireRR__WHEEL__TYRE_RADIUS_MOD = 0.42
tireRR__WHEEL__T_RelaxationLong = 2
tireRR__WHEEL__T_RelaxationLat = 3
tireRR__WHEEL__T_RelaxationMy = 100
tireRR__DIMENSION__UNLOADED_RADIUS = 0.42
tireRR__DIMENSION__WIDTH = 0.22
tireRR__DIMENSION__ASPECT_RATIO = 0.3
tireRR__DIMENSION__RIM_RADIUS = 0.229
tireRR__DIMENSION__RIM_WIDTH = 0.2667
tireRR__VERTICAL__VERTICAL_STIFFNESS = 240000
tireRR__VERTICAL__VERTICAL_DAMPING = 100
tireRR__VERTICAL__BREFF = 3.0e-8
tireRR__VERTICAL__DREFF = 0
tireRR__VERTICAL__FREFF = 0
tireRR__VERTICAL__Q_RE0 = 1
tireRR__VERTICAL__Q_V1 = 0
tireRR__VERTICAL__Q_V2 = 0
tireRR__VERTICAL__Q_FZ1 = 25
tireRR__VERTICAL__Q_FZ2 = 0
tireRR__VERTICAL__Q_FZ3 = 0
tireRR__VERTICAL__Q_FCX = 0
tireRR__VERTICAL__Q_FCY = 0
tireRR__VERTICAL__Q_FCY2 = 0
tireRR__VERTICAL__PFZ1 = 0
tireRR__SIMULATION__KPUMIN = -1.5
tireRR__SIMULATION__KPUMAX = 1.5
tireRR__SIMULATION__ALPMIN = -1.6
tireRR__SIMULATION__ALPMAX = 1.6
tireRR__SIMULATION__CAMMIN = -0.32
tireRR__SIMULATION__CAMMAX = 0.32
tireRR__SIMULATION__FZMIN = 1
tireRR__SIMULATION__FZMAX = 20000
tireRR__SIMULATION__LONGVL = 11
tireRR__SIMULATION__VXLOW = 1
tireRR__SIMULATION__PRESMIN = 10000
tireRR__SIMULATION__PRESMAX = 1000000
tireRR__SCALING__LFZO = 1
tireRR__SCALING__LCX = 1
tireRR__SCALING__LMUX = 0.97
tireRR__SCALING__LEX = 1
tireRR__SCALING__LKX = 1
tireRR__SCALING__LHX = 1
tireRR__SCALING__LVX = 1
tireRR__SCALING__LGAX = 1
tireRR__SCALING__LCY = 1
tireRR__SCALING__LMUY = 0.97
tireRR__SCALING__LEY = 1
tireRR__SCALING__LKY = 1
tireRR__SCALING__LHY = 1
tireRR__SCALING__LVY = 1
tireRR__SCALING__LGAY = 1
tireRR__SCALING__LTR = 1
tireRR__SCALING__LRES = 1
tireRR__SCALING__LGAZ = 1
tireRR__SCALING__LXAL = 1
tireRR__SCALING__LYKA = 1
tireRR__SCALING__LVYKA = 1
tireRR__SCALING__LS = 1
tireRR__SCALING__LSGKP = 1
tireRR__SCALING__LSGAL = 1
tireRR__SCALING__LGYR = 1
tireRR__SCALING__LMX = 1
tireRR__SCALING__LVMX = 1
tireRR__SCALING__LMY = 1
tireRR__SCALING__LMUV = 0
tireRR__SCALING__LCZ = 1
tireRR__SCALING__LMPHI = 1
tireRR__LONGITUDINAL__PCX1 = 1.6
tireRR__LONGITUDINAL__PDX1 = 1.5
tireRR__LONGITUDINAL__PDX2 = -0.04
tireRR__LONGITUDINAL__PDX3 = 0.1
tireRR__LONGITUDINAL__PEX1 = 0.7
tireRR__LONGITUDINAL__PEX2 = -0.17
tireRR__LONGITUDINAL__PEX3 = 0.023
tireRR__LONGITUDINAL__PEX4 = -0.14
tireRR__LONGITUDINAL__PKX1 = 30.7
tireRR__LONGITUDINAL__PKX2 = 0.27
tireRR__LONGITUDINAL__PKX3 = 0.13
tireRR__LONGITUDINAL__PHX1 = 0
tireRR__LONGITUDINAL__PHX2 = 0
tireRR__LONGITUDINAL__PVX1 = 0
tireRR__LONGITUDINAL__PVX2 = 0
tireRR__LONGITUDINAL__RBX1 = 17.4
tireRR__LONGITUDINAL__RBX2 = 12.9
tireRR__LONGITUDINAL__RCX1 = 1.1
tireRR__LONGITUDINAL__REX1 = 0
tireRR__LONGITUDINAL__REX2 = 0
tireRR__LONGITUDINAL__RHX1 = 0.001
tireRR__LONGITUDINAL__PTX1 = 0.75
tireRR__LONGITUDINAL__PTX2 = 0.007
tireRR__LONGITUDINAL__PTX3 = -0.13
tireRR__LONGITUDINAL__PPX1 = 0
tireRR__LONGITUDINAL__PPX2 = 0
tireRR__LONGITUDINAL__PPX3 = 0
tireRR__LONGITUDINAL__PPX4 = 0
tireRR__LONGITUDINAL__RBX3 = 0
tireRR__OVERTURNING__QSX1 = -0.001
tireRR__OVERTURNING__QSX2 = 2.1
tireRR__OVERTURNING__QSX3 = -0.04
tireRR__OVERTURNING__QSX4 = 0
tireRR__OVERTURNING__QSX5 = 0
tireRR__OVERTURNING__QSX6 = 0
tireRR__OVERTURNING__QSX7 = 0
tireRR__OVERTURNING__QSX8 = 0
tireRR__OVERTURNING__QSX9 = 0
tireRR__OVERTURNING__QSX10 = 0
tireRR__OVERTURNING__QSX11 = 0
tireRR__OVERTURNING__QSX12 = 0
tireRR__OVERTURNING__QSX13 = 0
tireRR__OVERTURNING__QSX14 = 0
tireRR__OVERTURNING__PPMX1 = 0
tireRR__LATERAL__PCY1 = 1.5
tireRR__LATERAL__PDY1 = 1.2
tireRR__LATERAL__PDY2 = -0.09
tireRR__LATERAL__PDY3 = 0.1
tireRR__LATERAL__PEY1 = 0.1
tireRR__LATERAL__PEY2 = -1.2
tireRR__LATERAL__PEY3 = 0.05
tireRR__LATERAL__PEY4 = -8.1
tireRR__LATERAL__PKY1 = -75.5
tireRR__LATERAL__PKY2 = 4.65
tireRR__LATERAL__PKY3 = -0.6
tireRR__LATERAL__PHY1 = 0.003
tireRR__LATERAL__PHY2 = -0.0006
tireRR__LATERAL__PHY3 = 0.004
tireRR__LATERAL__PVY1 = 0.04
tireRR__LATERAL__PVY2 = -0.02

tireRR__LATERAL__PVY3 = -0.97
tireRR__LATERAL__PVY4 = -0.41
tireRR__LATERAL__RBY1 = 20.6
tireRR__LATERAL__RBY2 = -23.5
tireRR__LATERAL__RBY3 = 0.001
tireRR__LATERAL__RCY1 = 1
tireRR__LATERAL__REY1 = 0
tireRR__LATERAL__REY2 = 0
tireRR__LATERAL__RHY1 = -0.02
tireRR__LATERAL__RHY2 = 0
tireRR__LATERAL__RVY1 = 0.16
tireRR__LATERAL__RVY2 = 0.03
tireRR__LATERAL__RVY3 = 27.5
tireRR__LATERAL__RVY4 = -29.7
tireRR__LATERAL__RVY5 = 0.03
tireRR__LATERAL__RVY6 = 0
tireRR__LATERAL__PTY1 = 3.8
tireRR__LATERAL__PTY2 = 4.7
tireRR__LATERAL__PEY5 = 0
tireRR__LATERAL__PKY4 = 2
tireRR__LATERAL__PKY5 = 0
tireRR__LATERAL__PKY6 = 0
tireRR__LATERAL__PKY7 = 0
tireRR__LATERAL__PPY1 = 0
tireRR__LATERAL__PPY2 = 0
tireRR__LATERAL__PPY3 = 0
tireRR__LATERAL__PPY4 = 0
tireRR__LATERAL__PPY5 = 0
tireRR__LATERAL__RBY4 = 0
tireRR__ROLLING__QSY1 = 0.01
tireRR__ROLLING__QSY2 = 0
tireRR__ROLLING__QSY3 = 0
tireRR__ROLLING__QSY4 = 0
tireRR__ROLLING__QSY5 = 0
tireRR__ROLLING__QSY6 = 0
tireRR__ROLLING__QSY7 = 1
tireRR__ROLLING__QSY8 = 1
tireRR__ALIGNING__QBZ1 = 9
tireRR__ALIGNING__QBZ2 = 6.3
tireRR__ALIGNING__QBZ3 = -0.5
tireRR__ALIGNING__QBZ4 = -2.3
tireRR__ALIGNING__QBZ5 = 2.7
tireRR__ALIGNING__QBZ9 = -13.5
tireRR__ALIGNING__QBZ10 = 0
tireRR__ALIGNING__QCZ1 = 1.1
tireRR__ALIGNING__QDZ1 = 0.08
tireRR__ALIGNING__QDZ2 = 0.004
tireRR__ALIGNING__QDZ3 = -1.9
tireRR__ALIGNING__QDZ4 = -2
tireRR__ALIGNING__QDZ6 = -0.005
tireRR__ALIGNING__QDZ7 = 0.01
tireRR__ALIGNING__QDZ8 = -0.65
tireRR__ALIGNING__QDZ9 = -0.06
tireRR__ALIGNING__QEZ1 = -9
tireRR__ALIGNING__QEZ2 = 11
tireRR__ALIGNING__QEZ3 = -5.9
tireRR__ALIGNING__QEZ4 = 0.24
tireRR__ALIGNING__QEZ5 = -15.9
tireRR__ALIGNING__QHZ1 = 0.007
tireRR__ALIGNING__QHZ2 = -0.001
tireRR__ALIGNING__QHZ3 = -0.18
tireRR__ALIGNING__QHZ4 = 0.23
tireRR__ALIGNING__SSZ1 = -0.01
tireRR__ALIGNING__SSZ2 = 0.05
tireRR__ALIGNING__SSZ3 = 2.4
tireRR__ALIGNING__SSZ4 = -1
tireRR__ALIGNING__QTZ1 = 0
tireRR__ALIGNING__MBELT = 0
tireRR__ALIGNING__QBZ6 = 0
tireRR__ALIGNING__QDZ10 = 0
tireRR__ALIGNING__QDZ11 = 0
tireRR__ALIGNING__PPZ1 = 0
tireRR__ALIGNING__PPZ2 = 0
tireRR__TURNSLIP__PDXP1 = 0.4
tireRR__TURNSLIP__PDXP2 = 0
tireRR__TURNSLIP__PDXP3 = 0
tireRR__TURNSLIP__PKYP1 = 1
tireRR__TURNSLIP__PDYP1 = 0.4
tireRR__TURNSLIP__PDYP2 = 0
tireRR__TURNSLIP__PDYP3 = 0
tireRR__TURNSLIP__PDYP4 = 0
tireRR__TURNSLIP__PHYP1 = 1
tireRR__TURNSLIP__PHYP2 = 0.15
tireRR__TURNSLIP__PHYP3 = 0
tireRR__TURNSLIP__PHYP4 = -4
tireRR__TURNSLIP__PECP1 = 0.5
tireRR__TURNSLIP__PECP2 = 0
tireRR__TURNSLIP__QDTP1 = 10
tireRR__TURNSLIP__QCRP1 = 0.2
tireRR__TURNSLIP__QCRP2 = 0.1
tireRR__TURNSLIP__QBRP1 = 0.1
tireRR__TURNSLIP__QDRP1 = 1
tireRR__TURNSLIP__QDRP2 = 0
tireRR__CONTACTPATCH__Q_RA1 = 0
tireRR__CONTACTPATCH__Q_RA2 = 0
tireRR__CONTACTPATCH__Q_RB1 = 0
tireRR__CONTACTPATCH__Q_RB2 = 0
tireRR__CONTACTPATCH__k1_TireFB_PT1 = 0.002
tireRR__CONTACTPATCH__k1_WheelsFB_PT1 = 0.002
tireRR__CONTACTPATCH__k2_TireFB_PT1 = 0.002
tireRR__CONTACTPATCH__p_Tires_Pa = 220000
tireRR__STRUCTURAL__LONGITUDINAL_STIFFNESS = 450000
tireRR__STRUCTURAL__LATERAL_STIFFNESS = 120000
tireRR__STRUCTURAL__PCFX1 = 0
tireRR__STRUCTURAL__PCFX2 = 0
tireRR__STRUCTURAL__PCFX3 = 0
tireRR__STRUCTURAL__PCFY1 = 0
tireRR__STRUCTURAL__PCFY2 = 0
tireRR__STRUCTURAL__PCFY3 = 0
VEH__VehicleData__I_K_Vehicle_kgm2__11 = 300
VEH__VehicleData__I_K_Vehicle_kgm2__12 = 0
VEH__VehicleData__I_K_Vehicle_kgm2__13 = 0
VEH__VehicleData__I_K_Vehicle_kgm2__21 = 0
VEH__VehicleData__I_K_Vehicle_kgm2__22 = 1000
VEH__VehicleData__I_K_Vehicle_kgm2__23 = 0
VEH__VehicleData__I_K_Vehicle_kgm2__31 = 0
VEH__VehicleData__I_K_Vehicle_kgm2__32 = 0
VEH__VehicleData__I_K_Vehicle_kgm2__33 = 1500
VEH__Tires__p_Tires_pa__1 = 220000
VEH__Tires__p_Tires_pa__2 = 220000
VEH__Tires__p_Tires_pa__3 = 220000
VEH__Tires__p_Tires_pa__4 = 220000
VEH__Brakes__mue_BrakePadsFrRe_static__1 = 0.6
VEH__Brakes__mue_BrakePadsFrRe_static__2 = 0.6
VEH__Brakes__mue_BrakePadsFrRe_kinetic__1 = 0.6
VEH__Brakes__mue_BrakePadsFrRe_kinetic__2 = 0.6
VEH__Brakes__d_BrakeActuatorBoreFrRe_m__1 = 0.0798
VEH__Brakes__d_BrakeActuatorBoreFrRe_m__2 = 0.0798
VEH__Brakes__r_BrakePadsMeanLeverFrRe_m__1 = 0.149
VEH__Brakes__r_BrakePadsMeanLeverFrRe_m__2 = 0.149
VEH__Brakes__n_BrakePadsNumberFrRe__1 = 1
VEH__Brakes__n_BrakePadsNumberFrRe__2 = 1
POWTR__ENGINE__n_lb_rpm__1 = 2000
POWTR__ENGINE__n_lb_rpm__2 = 2000
POWTR__ENGINE__n_lb_rpm__3 = 4499
POWTR__ENGINE__n_lb_rpm__4 = 5155
POWTR__ENGINE__n_lb_rpm__5 = 5651
POWTR__ENGINE__n_lb_rpm__6 = 6026
POWTR__ENGINE__n_lb_rpm__7 = 6482
POWTR__TRANSMISSION__gear__1 = 0
POWTR__TRANSMISSION__gear__2 = 1
POWTR__TRANSMISSION__gear__3 = 2
POWTR__TRANSMISSION__gear__4 = 3
POWTR__TRANSMISSION__gear__5 = 4
POWTR__TRANSMISSION__gear__6 = 5
POWTR__TRANSMISSION__gear__7 = 6
POWTR__TRANSMISSION__gear_ratio__1 = 0
POWTR__TRANSMISSION__gear_ratio__2 = 2.916667
POWTR__TRANSMISSION__gear_ratio__3 = 1.866667
POWTR__TRANSMISSION__gear_ratio__4 = 1.375
POWTR__TRANSMISSION__gear_ratio__5 = 1.111111
POWTR__TRANSMISSION__gear_ratio__6 = 0.952381
POWTR__TRANSMISSION__gear_ratio__7 = 0.8888889
POWTR__TRANSMISSION__gear_efficiency__1 = 1
POWTR__TRANSMISSION__gear_efficiency__2 = 0.91
POWTR__TRANSMISSION__gear_efficiency__3 = 0.91
POWTR__TRANSMISSION__gear_efficiency__4 = 0.91
POWTR__TRANSMISSION__gear_efficiency__5 = 0.96
POWTR__TRANSMISSION__gear_efficiency__6 = 0.96
POWTR__TRANSMISSION__gear_efficiency__7 = 0.96
INIT__initialvalues__x0_verticaldynamics__1 = 0
INIT__initialvalues__x0_verticaldynamics__2 = 0
INIT__initialvalues__x0_verticaldynamics__3 = 0
INIT__initialvalues__z0_TireDeflection_m__1 = 0.0143
INIT__initialvalues__z0_TireDeflection_m__2 = 0.0143
INIT__initialvalues__z0_TireDeflection_m__3 = 0.0133
INIT__initialvalues__z0_TireDeflection_m__4 = 0.0133
SUS__Compliance__cz_SpringRateFrRe_Npm__1 = 120000
SUS__Compliance__cz_SpringRateFrRe_Npm__2 = 80000
SUS__Compliance__F0z_SpringPreloadFrRe_N__1 = 2000
SUS__Compliance__F0z_SpringPreloadFrRe_N__2 = 3000
SUS__Compliance__Cz_DamperRateFrRe_Nspm__1 = 2000
SUS__Compliance__Cz_DamperRateFrRe_Nspm__2 = 1200
SUS__Kinematics__nu0_ToeATSteerCenterFrRe_rad__1 = 0
SUS__Kinematics__nu0_ToeATSteerCenterFrRe_rad__2 = 0
SUS__Kinematics__k_RollSteerVSHeightFrRe_radpm__1 = 0
SUS__Kinematics__k_RollSteerVSHeightFrRe_radpm__2 = 0
SUS__Kinematics__k_CasterATSteerCenterF__1 = 0
SUS__Kinematics__k_CasterATSteerCenterF__2 = 0.01
SUS__Kinematics__k_CasterVSHeightFrRe__1 = 0
SUS__Kinematics__k_CasterVSHeightFrRe__2 = 0
SUS__Kinematics__k_CamberATSteerCenterF__1 = 0
SUS__Kinematics__k_CamberATSteerCenterF__2 = 0.01
SUS__Kinematics__k_CamberVSHeightFrRe__1 = 0
SUS__Kinematics__k_CamberVSHeightFrRe__2 = 0
SUS__Antisway__r_AntiSwayArmRadiusFrRe_m__1 = 0.4
SUS__Antisway__r_AntiSwayArmRadiusFrRe_m__2 = 0.3
SUS__Antisway__phi_AntiSwayNeutralAngleFrRe_rad__1 = 0
SUS__Antisway__phi_AntiSwayNeutralAngleFrRe_rad__2 = 0
SUS__Antisway__c_AntiSwayTSpringFrRe_Nmprad__1 = 5000
SUS__Antisway__c_AntiSwayTSpringFrRe_Nmprad__2 = 2400
current_vehicleparameters = "pa"
x0_stm_vehiclestates = repmat(0, 8, 1)
VEH__VehicleData__m_Vehicle_kg = 300
INIT__initialvalues__Vehicle_InitialVelocity_mps__1 = 10
VEH__Aerodynamics__cw_LongitudinalDrag = 0
VEH__Aerodynamics__A_LongitudinalDrag_m2 = 0
INIT__initialvalues__v0z_Wheels_mps__1 = 0
INIT__initialvalues__v0z_Wheels_mps__2 = 0
INIT__initialvalues__v0z_Wheels_mps__3 = 0

INIT__initialvalues__v0z_Wheels_mps__4 = 0
INIT__initialvalues__Vehicle_InitialVelocity_mps__2 = 0
INIT__initialvalues__omega0_Wheels_radps__1 = 25
INIT__initialvalues__omega0_Wheels_radps__2 = 25
INIT__initialvalues__omega0_Wheels_radps__3 = 25
INIT__initialvalues__omega0_Wheels_radps__4 = 25
INIT__initialvalues__Vehicle_InitialVelocity_mps__3 = 0